# Grasshopper definition spiral_tower.gh (Grasshopper 1.0.7)

# ----
# Connect to ROS and load robot
toggle = BooleanToggle(False)
# Princeton University | School of Architecture | Fall 2023
# ARC 380 – Introduction to Robotics for Digital Fabrication
# Professor Arash Adel | Assistant-in-Instruction: Daniel Ruan
# Session 12 Workshop
# 
# ABB IRB120 Robot Drawing w/ COMPAS_FAB
# 
# ADR Laboratory | Princeton University
ros = ROSConnect(connect=toggle)  # -> ros_client, is_connected; inputs port: Int32, connect: Boolean
#   port ip: The ip address ROS. Defaults to 127.0.0.1.
#   port port: The port of ROS. Defaults to 9090.
#   port connect: If True, connects to ROS. If False, disconnects from ROS. Defaults to False.
#   port ros_client: The ROS client.
#   port is_connected: True if connection established.
# ---------- ros: Python ----------
"""
Connect or disconnect to ROS.

COMPAS FAB v0.28.0
"""
from ghpythonlib.componentbase import executingcomponent as component
from scriptcontext import sticky as st

from compas_fab.backends import RosClient
from compas_fab.ghpython.components import create_id


class ROSConnect(component):
    def RunScript(self, ip, port, connect):
        ros_client = None

        ip = ip or "127.0.0.1"
        port = port or 9090

        key = create_id(self, "ros_client")
        ros_client = st.get(key, None)

        if ros_client:
            st[key].close()
        if connect:
            st[key] = RosClient(ip, port)
            st[key].run(5)

        ros_client = st.get(key, None)
        is_connected = ros_client.is_connected if ros_client else False
        return (ros_client, is_connected)
# ---------- end ros ----------
robot = ROSRobot(ros_client=ros.ros_client, load=Button())  # -> robot; inputs load: Boolean
#   port ros_client: The ROS client.
#   port load: If True, loads the robot from ROS. Defaults to False.
# ---------- robot: Python ----------
"""
Load robot directly from ROS.

COMPAS FAB v0.28.0
"""
from compas_ghpython.artists import RobotModelArtist
from ghpythonlib.componentbase import executingcomponent as component
from scriptcontext import sticky as st

from compas_fab.ghpython.components import create_id


class ROSRobot(component):
    def RunScript(self, ros_client, load):
        key = create_id(self, "robot")

        if ros_client and ros_client.is_connected and load:
            # Load URDF from ROS
            st[key] = ros_client.load_robot(load_geometry=True, precision="12f")
            st[key].artist = RobotModelArtist(st[key].model)

        robot = st.get(key, None)
        if robot:  # client sometimes need to be restarted, without needing to reload geometry
            robot.client = ros_client
        return robot
# ---------- end robot ----------

# ---- group: Input geometry
drawing_polyline = Curve(<curve referenced from the Rhino model>)

# ----
# 'Taught' points
pt_along_x_axis = Point(<point referenced from the Rhino model>)
pt_in_xy_plane = Point(<point referenced from the Rhino model>)
origin = Point(<point referenced from the Rhino model>)

# ----
# Define task
python = GhPythonScript(polyline=drawing_polyline)  # -> out, target_frames; inputs polyline: Polyline
# ---------- python: Python ----------
from math import radians

from compas_rhino.conversions import RhinoPolyline
from compas.geometry import Frame

# Convert Rhino polyline to compas polyline
rp = RhinoPolyline.from_geometry(polyline)
compas_polyline = rp.to_compas()

# Split polyline based on angle threshold
segments = compas_polyline.split_at_corners(radians(3))

# Get start points of each segment
points = [segment.point(0) for segment in segments]
# Append end point of last segment
points.append(segments[-1].point(1))

# Create target frames at each point, with z axis pointing down
target_frames = [Frame(pt, [1, 0, 0], [0, -1, 0]) for pt in points]
# ---------- end python ----------

num_positions = Slider(6, range=1..20)
num = Number(0)
num_layers = Slider(7, range=1..12)

# ----
# Define frames
# Planning frame
# Task frame
python_2 = GhPythonScript(pt1=origin, pt2=pt_along_x_axis, pt3=pt_in_xy_plane)  # -> out, task_frame; inputs pt1: Point3d, pt2: Point3d, pt3: Point3d
# ---------- python_2: Python ----------
import compas.geometry as cg

task_frame = cg.Frame.from_points(pt1, pt2, pt3)
# ---------- end python_2 ----------
python_3 = GhPythonScript()  # -> out, planning_frame
# ---------- python_3: Python ----------
from compas.geometry import Frame

planning_frame = Frame([0, 1, 0], [0, 1, 0], [-1, 0, 0])
# ---------- end python_3 ----------

radius = Slider(6, range=0.5..30)
num_positions_2 = Slider(6, range=1..20)
num_2 = Number(0)
num_layers_2 = Slider(7, range=1..12)
radius_2 = Slider(6, range=0.5..30)
vec = VectorXYZ(XComponent=Slider(220, range=0..500), YComponent=Slider(160, range=0..500), ZComponent=num)  # -> Vector, Length
small_disk = Brep(<brep referenced from the Rhino model>)
large_disk = Brep(<brep referenced from the Rhino model>)
acrylic = Brep(<brep referenced from the Rhino model>)
block = Brep(<brep referenced from the Rhino model>)
vec_2 = VectorXYZ(XComponent=Slider(220, range=0..500), YComponent=Slider(160, range=0..500), ZComponent=num_2)  # -> Vector, Length
small_disk_2 = Brep(<brep referenced from the Rhino model>)
large_disk_2 = Brep(<brep referenced from the Rhino model>)
acrylic_2 = Brep(<brep referenced from the Rhino model>)
block_2 = Brep(<brep referenced from the Rhino model>)
python_4 = GhPythonScript(
    acrylic=acrylic,
    small_disk=small_disk,
    large_disk=large_disk,
    block=block,
    positions=num_positions,
    r=radius,
    num_layers=num_layers,
    starting_centroid=vec.Vector,
    triangle_buffer=Slider(3.5, range=0..10))  # -> a, b, c, d; inputs acrylic: Brep, small_disk: Brep, large_disk: Brep, block: Brep, positions: Int32, num_layers: Int32, starting_centroid: Vector3d
# ---------- python_4: Python ----------
import compas.geometry as cg
from compas_rhino.geometry import RhinoBrep
from compas_rhino.conversions import brep_to_compas_box
from math import pi, cos, sin
import Rhino.Geometry as rg

c_acrylic = RhinoBrep.from_native(acrylic)
c_block = RhinoBrep.from_native(block)
c_small = RhinoBrep.from_native(small_disk)
c_large = RhinoBrep.from_native(large_disk)

print([v.point for v in c_small.vertices])
print(c_small.frame)
vmp = rg.VolumeMassProperties.Compute(c_small.native_brep, volume=False, firstMoments=True, secondMoments=False, productMoments=False)
print(vmp.Centroid)

com = cg.centroid_points([v.point for v in c_block.vertices])
width = max(abs(c_block.vertices[0].point.x - com[0]),abs(c_block.vertices[0].point.y - com[1])) * 2
length = min(abs(c_block.vertices[0].point.x - com[0]),abs(c_block.vertices[0].point.y - com[1])) * 2
height = abs(c_block.vertices[0].point.z - com[2]) * 2
com = cg.centroid_points([v.point for v in c_acrylic.vertices])
a_height = abs(c_acrylic.vertices[0].point.z - com[2]) * 2

new_objects = [] # new blocks
red_acrylic = []
blue_acrylic = []
yellow_acrylic = []

def copy_object(obj, angle=0, new_pos=cg.Vector(0, 0, 0)):
    obj_copy = obj.copy()
    vmp = rg.VolumeMassProperties.Compute(obj.native_brep, volume=False, firstMoments=True, secondMoments=False, productMoments=False)
    #pos = cg.centroid_points([v.point for v in obj.vertices])
    pos = vmp.Centroid
    obj_copy.translate(cg.Vector(-pos[0], -pos[1], 0))
    obj_copy.rotate(angle)
    obj_copy.translate(new_pos)
    return obj_copy.native_brep

def place_triangles(centroid, is_even):
    d = 3**0.5 / 6 * width + length / 2 + triangle_buffer # add buffer
    if is_even:
        new_objects.append(copy_object(c_block, pi / 2, centroid + cg.Vector(cos(3 * pi / 2) * d, sin(3 * pi / 2) * d, 0)))
        new_objects.append(copy_object(c_block, pi / 6, centroid + cg.Vector(cos(pi / 6) * d, sin(pi / 6) * d, 0)))
        new_objects.append(copy_object(c_block, 5 * pi / 6, centroid + cg.Vector(cos(5 * pi / 6) * d, sin(5 * pi / 6) * d, 0)))
    else:
        new_objects.append(copy_object(c_block, pi / 2, centroid + cg.Vector(cos(pi / 2) * d, sin(pi / 2) * d, 0)))
        new_objects.append(copy_object(c_block, -pi / 6, centroid + cg.Vector(cos(-pi / 6) * d, sin(-pi / 6) * d, 0)))
        new_objects.append(copy_object(c_block, -5 * pi / 6, centroid + cg.Vector(cos(-5 * pi / 6) * d, sin(-5 * pi / 6) * d, 0)))

def place_acrylic(centroid, piece, idx):
    if idx % 3 == 0:
        acrylic_list = red_acrylic
    elif idx % 3 == 1:
        acrylic_list = blue_acrylic
    else:
        acrylic_list = yellow_acrylic
    acrylic_list.append(copy_object(piece, 0, centroid))

class SpiralCentroidCalculator:
    """
    Gets the centroids of the levels of the tower.
    All of the centroids are on the perimeter of a circle that is centered
    around the overall center of the tower, and they will all be evenly spaced
    around the circle.
    """

    def __init__(self, num_positions, radius):
        """
        num_positions decides how many times the circle is partitioned
        radius determines the distance from the center of the tower centroids are placed
        """
        print(num_positions, radius)
        self.r = radius
        self.angles = [i * pi * 2 / num_positions for i in range(num_positions)]
        self.curr_idx = 0

    def get_centroid(self):
        """
        Gets position of next centroid in the tower
        """
        angle = self.angles[self.curr_idx]
        self.curr_idx = (self.curr_idx + 1) % len(self.angles)

        return cg.Vector(self.r * cos(angle), self.r * sin(angle), 0)

centroids = SpiralCentroidCalculator(positions, r)
original = cg.Vector(*starting_centroid)
current = original.copy()

for i in range(num_layers):
    place_triangles(current, i % 2 == 0)
    current.z += height
    placed_acrylic = c_large
    if i == num_layers - 1:
        placed_acrylic = c_small
    #elif i % 2:
    #    placed_acrylic = c_large
    current += centroids.get_centroid()
    place_acrylic(current, placed_acrylic, i)
    current.z += a_height

a = new_objects
b = red_acrylic
c = blue_acrylic
d = yellow_acrylic
# ---------- end python_4 ----------
python_5 = GhPythonScript(
    acrylic=acrylic_2,
    small_disk=small_disk_2,
    large_disk=large_disk_2,
    block=block_2,
    positions=num_positions_2,
    r=radius_2,
    num_layers=num_layers_2,
    starting_centroid=vec_2.Vector,
    triangle_buffer=Slider(3.5, range=0..10))  # -> a, b, c, d; inputs acrylic: Brep, small_disk: Brep, large_disk: Brep, block: Brep, positions: Int32, num_layers: Int32, starting_centroid: Vector3d; same code as python_4

# ----
# Transform to robot (world) frame
python_6 = GhPythonScript(frames=python.target_frames, planning_frame=python_3.planning_frame, task_frame=python_2.task_frame)  # -> out, xformed_frames; inputs frames: list
# ---------- python_6: Python ----------
from copy import deepcopy
from compas.geometry import Transformation
from compas.geometry import Frame

# Compute transformation from planning frame to task frame
xform = Transformation.from_frame_to_frame(planning_frame, task_frame)

# Apply transform to frames
xformed_frames = deepcopy(frames)
print(xformed_frames[0])
for frame in xformed_frames:
    frame.transform(xform)
print(xformed_frames[0])
# ---------- end python_6 ----------

# ----
# Attach tool to robot
pen_tool_frame = Plane(PlaneXY(0, 0, 0.2))
pen_tool_mesh = Mesh(<mesh referenced from the Rhino model>)
tool = AttachedTool(robot=robot, visual_mesh=pen_tool_mesh, tcf_plane=pen_tool_frame)  # -> robot; inputs visual_mesh: Mesh, collision_mesh: Mesh
#   port visual_mesh: A visual mesh for the tool.
#   port collision_mesh: A collision mesh for the tool.
#   port tcf_plane: The frame of the tool in tool0 frame.
#   port group: The planning group to which the tool should be attached.
# ---------- tool: Python ----------
"""
Attach a tool to the robot.

COMPAS FAB v0.28.0
"""
from ghpythonlib.componentbase import executingcomponent as component
from compas_rhino.conversions import RhinoMesh
from compas_rhino.conversions import plane_to_compas_frame

from compas.geometry import Frame
from compas_fab.robots import Tool


class AttachToolComponent(component):
    def RunScript(self, robot, visual_mesh, collision_mesh, tcf_plane, group):
        if robot and robot.client and robot.client.is_connected and visual_mesh:
            if not collision_mesh:
                collision_mesh = visual_mesh

            c_visual_mesh = RhinoMesh.from_geometry(visual_mesh).to_compas()
            c_collision_mesh = RhinoMesh.from_geometry(collision_mesh).to_compas()

            if not tcf_plane:
                frame = Frame.worldXY()
            else:
                frame = plane_to_compas_frame(tcf_plane)
            tool = Tool(c_visual_mesh, frame, c_collision_mesh)

            robot.attach_tool(tool, group)

        return robot
# ---------- end tool ----------

block_color = Colour(RGB(255, 232, 166))
yellow = Colour(RGB(255, 255, 0))
blue = Colour(RGB(0, 0, 191))
brep = Brep(python_4.a)
red = Colour(RGB(255, 0, 0))
brep_2 = Brep(python_4.d)
brep_3 = Brep(python_4.b)
block_color_2 = Colour(RGB(255, 232, 166))
yellow_2 = Colour(RGB(255, 255, 0))
blue_2 = Colour(RGB(0, 0, 191))
brep_4 = Brep(python_5.a)
brep_5 = Brep(python_5.d)
red_2 = Colour(RGB(255, 0, 0))
brep_6 = Brep(python_5.b)
brep_7 = Brep(python_4.c)
material = CreateMaterial(Diffuse=block_color, Specular=RGB(255, 255, 255), Emission=RGB(0, 0, 0), Transparency=0, Shine=0)
brep_8 = Brep(python_5.c)
material_2 = CreateMaterial(Diffuse=yellow, Specular=RGB(255, 255, 255), Emission=RGB(0, 0, 0), Transparency=0, Shine=0)
material_3 = CreateMaterial(Diffuse=red, Specular=RGB(255, 255, 255), Emission=RGB(0, 0, 0), Transparency=0, Shine=0)
material_4 = CreateMaterial(Diffuse=blue, Specular=RGB(255, 255, 255), Emission=RGB(0, 0, 0), Transparency=0, Shine=0)
material_5 = CreateMaterial(Diffuse=block_color_2, Specular=RGB(255, 255, 255), Emission=RGB(0, 0, 0), Transparency=0, Shine=0)
material_6 = CreateMaterial(Diffuse=yellow_2, Specular=RGB(255, 255, 255), Emission=RGB(0, 0, 0), Transparency=0, Shine=0)
material_7 = CreateMaterial(Diffuse=red_2, Specular=RGB(255, 255, 255), Emission=RGB(0, 0, 0), Transparency=0, Shine=0)
material_8 = CreateMaterial(Diffuse=blue_2, Specular=RGB(255, 255, 255), Emission=RGB(0, 0, 0), Transparency=0, Shine=0)
preview = CustomPreview(Geometry=brep_7, Material=material_2)
preview_2 = CustomPreview(Geometry=brep_3, Material=material_3)
preview_3 = CustomPreview(Geometry=brep_2, Material=material_4)
preview_4 = CustomPreview(Geometry=brep, Material=material)

# ----
# Visualize frames/drawing
# in robot space
visualize_frames = GhPythonScript(frames=python_6.xformed_frames)  # -> rh_planes; inputs frames: list
# ---------- visualize_frames: Python ----------
from compas_rhino.conversions import frame_to_rhino_plane

rh_planes = [frame_to_rhino_plane(frame) for frame in frames]
# ---------- end visualize_frames ----------
pline = PolyLine(Vertices=visualize_frames, Closed=False)

preview_5 = CustomPreview(Geometry=brep_8, Material=material_6)
preview_6 = CustomPreview(Geometry=brep_6, Material=material_7)
preview_7 = CustomPreview(Geometry=brep_5, Material=material_8)
preview_8 = CustomPreview(Geometry=brep_4, Material=material_5)

# ----
# Compute trajectory (MoveIt)
python_7 = GhPythonScript(ros_client=ros.ros_client, tool_mesh=pen_tool_mesh, tcf_plane=pen_tool_frame, frames=python_6.xformed_frames)  # -> out, trajectory; inputs tool_mesh: Mesh, tcf_plane: Plane, frames: list
# ---------- python_7: Python ----------
from copy import deepcopy
from math import radians

from compas_fab.backends import RosClient

from compas_rhino.conversions import plane_to_compas_frame
from compas.geometry import Frame
from compas.geometry import Transformation


robot = ros_client.load_robot()

group = robot.main_group_name

tool_xform = Transformation.from_frame(plane_to_compas_frame(tcf_plane))

frames_flange = deepcopy(frames)
for frame in frames_flange:
    frame.transform(tool_xform)


start_configuration = robot.zero_configuration()
start_configuration.joint_values = (0, 0, 0, 0, radians(90), 0)

trajectory = robot.plan_cartesian_motion(frames_flange,
                                         start_configuration,
                                         group=group,
                                         options=dict(
                                             max_step=0.01,
                                             avoid_collisions=True,
                                         ))

print("Computed cartesian path with %d configurations. " % len(trajectory.points))
print("Following %d%% of requested trajectory." % (trajectory.fraction * 100))
print("Executing this path at full speed would take approx. %.3f seconds." % trajectory.time_from_start)
# ---------- end python_7 ----------
panel = Panel(python_7.out)

# ----
# Visualize trajectory
number_slider = Slider(0, range=0..150)
trajectory_visualize = TrajectoryVisualize(robot=tool, trajectory=python_7.trajectory)  # -> start_configuration, configurations, fraction, time, planes, P, V, A
#   port group: The planning group for which this trajectory was planned.
#   port trajectory: The calculated trajectory.
#   port start_configuration: The start configuration of the trajectory.
#   port configurations: The full configurations along the trajectory.
#   port fraction: Indicates the fraction of requested trajectory that was calculated, e.g. 1 means the full trajectory was found.
#   port time: The time which is needed to execute that trajectory at full speed.
#   port planes: The planes of the robot's end-effector.
#   port P: The positions along the trajectory
#   port V: The velocities along the trajectory
#   port A: The accelerations along the trajectory
# ---------- trajectory_visualize: Python ----------
"""
Visualizes a trajectory.

COMPAS FAB v0.28.0
"""
from compas_ghpython import draw_frame
from compas_ghpython import list_to_ghtree
from ghpythonlib.componentbase import executingcomponent as component


class TrajectoryVisualize(component):
    def RunScript(self, robot, group, trajectory):
        start_configuration = None
        configurations = []
        fraction = 0.0
        time = 0.0

        planes = []
        positions = []
        velocities = []
        accelerations = []

        if robot and trajectory:
            group = group or robot.main_group_name

            for c in trajectory.points:
                configurations.append(
                    robot.merge_group_with_full_configuration(c, trajectory.start_configuration, group)
                )
                frame = robot.forward_kinematics(c, group, options=dict(solver="model"))
                planes.append(draw_frame(frame))
                positions.append(c.positions)
                velocities.append(c.velocities)
                accelerations.append(c.accelerations)

            start_configuration = trajectory.start_configuration
            fraction = trajectory.fraction
            time = trajectory.time_from_start

        P = list_to_ghtree(list(zip(*positions)))
        V = list_to_ghtree(list(zip(*velocities)))
        A = list_to_ghtree(list(zip(*accelerations)))

        # return outputs if you have them; here I try it for you:
        return (start_configuration, configurations, fraction, time, planes, P, V, A)
# ---------- end trajectory_visualize ----------
toggle_2 = BooleanToggle(True)
item = ListItem(List=trajectory_visualize.configurations, Index=number_slider, Wrap=True)
robot_visualize = RobotVisualize(robot=tool, configuration=item, show_visual=toggle_2, show_end_effector_frame=toggle_2)  # -> visual, collision, collision_meshes, attached_meshes, frames, base_frame, ee_frame; inputs show_visual: Boolean, show_collision: Boolean, show_frames: Boolean, show_base_frame: Boolean, show_end_effector_frame: Boolean, show_cm: Boolean, show_acm: Boolean
#   port group: The planning group used for end-effector and base visualization.
#   port configuration: The robot's full configuration.
#   port show_visual: Whether or not to show the robot's visual meshes.
#   port show_collision: Whether or not to show the robot's collision meshes.
#   port show_frames: Whether or not to show the robot's joint frames.
#   port show_base_frame: Whether or not to show the robot's base frame.
#   port show_end_effector_frame: Whether or not to show the robot's end-effector frame.
#   port show_cm: Whether or not to show the collision meshes (if any).
#   port show_acm: Whether or not to show the attached collision meshes (if any).
#   port visual: Rhino meshes of the robot's visual geometry (if any).
#   port collision: Rhino meshes of the robot's collision geometry (if any).
#   port collision_meshes: Rhino meshes of the scene's collision meshes (if any).
#   port attached_meshes: Rhino meshes of the scene's attached collision meshes (if any).
#   port frames: The robot's joint frames as Rhino planes (if any).
#   port base_frame: The robot's base frame as a Rhino plane (if any).
#   port ee_frame: The robot's end-effector frame as a Rhino plane (if any).
# ---------- robot_visualize: Python ----------
"""
Visualizes the robot.

COMPAS FAB v0.28.0
"""
import time

from compas.artists import Artist
from compas.geometry import Frame
from compas.geometry import Transformation
from ghpythonlib.componentbase import executingcomponent as component
from scriptcontext import sticky as st

from compas_fab.ghpython.components import create_id
from compas_fab.robots import PlanningScene


class RobotVisualize(component):
    def RunScript(
        self,
        robot,
        group,
        configuration,
        show_visual,
        show_collision,
        show_frames,
        show_base_frame,
        show_end_effector_frame,
        show_cm,
        show_acm,
    ):
        visual = None
        collision = None
        collision_meshes = None
        attached_meshes = None
        frames = None
        base_frame = None
        ee_frame = None

        if robot:
            show_visual = True if show_visual is None else show_visual
            show_cm = True if show_cm is None else show_cm
            show_acm = True if show_acm is None else show_acm
            configuration = configuration or robot.zero_configuration()

            robot.update(configuration, visual=show_visual, collision=show_collision)
            compas_frames = robot.transformed_frames(configuration, group)

            if show_visual:
                visual = robot.artist.draw_visual()

            if show_collision:
                collision = robot.artist.draw_collision()

            if show_base_frame:
                base_compas_frame = compas_frames[0]
                artist = Artist(base_compas_frame)
                base_frame = artist.draw()

            if show_end_effector_frame:
                ee_compas_frame = robot.forward_kinematics(configuration, group, options=dict(solver="model"))
                artist = Artist(ee_compas_frame)
                ee_frame = artist.draw()

            if show_frames:
                frames = []
                for compas_frame in compas_frames[1:]:
                    artist = Artist(compas_frame)
                    frame = artist.draw()
                    frames.append(frame)

            cached_scene_key = create_id(self, "cached_scene")

            if show_cm or show_acm:
                cached_scene = st.get(cached_scene_key)
                if not cached_scene:
                    cached_scene = {"time": 0}

                # expire cache if the component has not been executed in the last 2 seconds
                # this allows to slide through a list of configurations
                # without triggering refreshes of the scene in the middle of it
                if time.time() - cached_scene["time"] > 2:
                    update_scene = True
                else:
                    update_scene = False

                if update_scene:
                    scene = PlanningScene(robot)
                    scene = robot.client.get_planning_scene()

                if update_scene and show_cm:
                    collision_meshes = []

                    for co in scene.world.collision_objects:
                        header = co.header
                        frame_id = header.frame_id
                        cms = co.to_collision_meshes()

                        for cm in cms:
                            if cm.frame != Frame.worldXY():
                                t = Transformation.from_frame(cm.frame)
                                mesh = cm.mesh.transformed(t)
                            else:
                                mesh = cm.mesh

                            collision_meshes.append(Artist(mesh).draw())

                        cached_scene["cm"] = collision_meshes

                collision_meshes = cached_scene.get("cm", [])

                if update_scene and show_acm:
                    attached_meshes = []

                    for aco in scene.robot_state.attached_collision_objects:
                        for acm in aco.to_attached_collision_meshes():
                            frame_id = aco.object["header"]["frame_id"]
                            frame = robot.forward_kinematics(configuration, options=dict(link=frame_id))
                            t = Transformation.from_frame(frame)

                            # Local CM frame
                            if acm.collision_mesh.frame and acm.collision_mesh.frame != Frame.worldXY():
                                t = t * Transformation.from_frame(acm.collision_mesh.frame)

                            mesh = acm.collision_mesh.mesh.transformed(t)

                            attached_meshes.append(Artist(mesh).draw())

                    cached_scene["acm"] = attached_meshes

                attached_meshes = cached_scene.get("acm", [])

                cached_scene["time"] = time.time()
                st[cached_scene_key] = cached_scene

        return (
            visual,
            collision,
            collision_meshes,
            attached_meshes,
            frames,
            base_frame,
            ee_frame,
        )
# ---------- end robot_visualize ----------
